# Grasshopper definition bimsc24_datamgmt_faizan_assignment01.gh (Grasshopper 1.0.7)
# Copyright: CREATIVE COMMONS
# plug-ins: HAL for Grasshopper

sessionsettings = SessionSettings()
building_height = GetInteger(Slider(4, range=0..10), AtLeast=1, AtMost=1, Maximum=2147483647, Minimum=-2147483648, TreeAccess=False)
no_of_floors = GetInteger(Slider(13, range=0..100), AtLeast=1, AtMost=1, Maximum=2147483647, Minimum=-2147483648, TreeAccess=False)
series = Series(Start=0, Step=building_height, Count=no_of_floors)

# ---- group: # of rotation
number_slider = Slider(12, range=0..100)

# ---- group: Rotation of Floor
number_slider_2 = Slider(7, range=0..10)

# ----
curve = Curve(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)
unit_z = UnitZ(Factor=series)
building_rotation = GetInteger(number_slider_2, AtLeast=1, AtMost=1, Maximum=2147483647, Minimum=-2147483648, TreeAccess=False)
floor_rotation = GetInteger(number_slider, AtLeast=1, AtMost=1, Maximum=2147483647, Minimum=-2147483648, TreeAccess=False)
move = Move(Geometry=curve, Motion=unit_z)  # -> Geometry, Transform
area = Area(Geometry=move.Geometry)  # -> Area, Centroid
series_2 = Series(Start=0, Step=building_rotation, Count=floor_rotation)
radians = Radians(Degrees=series_2)

# ---- group: wall height
number_slider_3 = Slider(4, range=0..10)

# ----
rotate = Rotate(Geometry=move.Geometry, Angle=radians, Plane=area.Centroid)  # -> Geometry, reverse(Transform)
wall_height = GetInteger(number_slider_3, AtLeast=1, AtMost=1, Maximum=2147483647, Minimum=-2147483648, TreeAccess=False)
unit_z_2 = UnitZ(Factor=wall_height)
extrude = Extrude(Base=rotate.Geometry, Direction=unit_z_2)
surface = Surface(rotate.Geometry)
brep = Brep([surface, extrude])
context_bake = ContextBake(Geometry=brep)
